# Dynamo graph BF_AI세팅실행기.dyn (Dynamo 2.19.3.6394)
# author: BIM AI Assistant
# AI 브릿지 실행기

filename = Filename("C:\Users\wkgns\Desktop\스터디\BIM AI\BIM-AI\bridge\live_setup.py")
python = Python(IN[0]=filename)  # CPython3
# ---------- python.python (33 lines) ----------
import os
import traceback
import clr
clr.AddReference('RevitAPI')
clr.AddReference('RevitAPIUI')
clr.AddReference('RevitServices')
import Autodesk
from Autodesk.Revit.DB import *
from Autodesk.Revit.UI import *
from RevitServices.Persistence import DocumentManager
from RevitServices.Transactions import TransactionManager
doc = DocumentManager.Instance.CurrentDBDocument
uiapp = DocumentManager.Instance.CurrentUIApplication
uidoc = uiapp.ActiveUIDocument
TransactionManager.Instance.ForceCloseTransaction()
script_path = IN[0]
if not script_path or not os.path.exists(script_path):
    OUT = '[대기 중] 실행할 스크립트 파일이 없습니다: {}'.format(script_path)
else:
    try:
        with open(script_path, 'r', encoding='utf-8-sig') as f:
            ai_code = f.read()
        exec_scope = globals().copy()
        exec_scope['doc'] = doc
        exec_scope['uiapp'] = uiapp
        exec_scope['uidoc'] = uidoc
        exec_scope['__revit__'] = uiapp
        exec(ai_code, exec_scope)
        res_msg = exec_scope.get('RESULT_MSG', '세팅 완료')
        OUT = '[AI 자동 세팅 성공] {}'.format(res_msg)
    except Exception as e:
        OUT = '[실행 오류] {}
{}'.format(str(e), traceback.format_exc())
# ----------------------------------------
watch = Watch(python)
